# Grasshopper definition Beam_Cantilever_ToRFEM.gh (Grasshopper 1.0.7)
# plug-ins: Karamba3D, BH.UI.Grasshopper

# A minimum definition of a static system: geometry + supports + load + analysis + graphic output
number_slider = Slider(5, range=5..5000)
matselect = MaterialSelectionKaramba3D(menu=[dropdown(1), dropdown(4)])
panel = Panel(matselect)
Z = UnitZ(Factor="1000")
Y = UnitY(Factor="1000")
vec = VectorXYZ(XComponent=number_slider, YComponent=0, ZComponent=Slider(5, range=5..5000))  # -> Vector, Length
pt = Point("0,1,0")
beam_joints = BeamJointsKaramba3D(
    AtElementIdentifiers="0",
    CtKNMAtStartingNode=Z,
    CrKNmRadAtStartingNode=Y,
    CtKNMAtEndNode=Vector(0, 0, 0),
    CrKNmRadAtEndNode=Vector(0, 0, 0),
    menu=[buttons(off, off, on, off, on, off), buttons(off, off, off, off, off, off)])
crosecrselect = CrossSectionRangeSelectorKaramba3D(MaximumHeight_cm=-1, MaximumWidth_cm=-1, Material=matselect, menu=[dropdown(2), dropdown(1), dropdown(1)])
move = Move(Geometry=pt, Motion=vec.Vector)  # -> Geometry, Transform
range = Range(Domain=Domain(0, 1), Steps=Slider(1, range=1..5000))
ln = Line(StartPoint=pt, EndPoint=move.Geometry)
item = ListItem(List=crosecrselect, Index="5", Wrap=True)
panel_2 = Panel(item)
shatter = Shatter(Curve=ln, Parameters=range)
Z_2 = UnitZ(Factor="-2")
end = EndPoints(Curve=ln)  # -> Start, End
Z_3 = UnitZ(Factor="-11")
Z_4 = UnitZ(Factor="-3")
Z_5 = UnitZ(Factor="3")
Z_6 = UnitZ(Factor="-3")
Z_7 = UnitZ(Factor="-5")
supp = SupportKaramba3D(PosInd="0", menu=[buttons(on, on, on, on, on, on)])
loads = LoadsKaramba3D(Vector=Z_2, LCase="LC0", mode="Gravity")
loads_2 = LoadsKaramba3D(ForceVector=Z_3, Local=False, PosInd=end.End, LCase="LC1", mode="Point")
linetobeam = LineToBeamKaramba3D(
    Line=shatter,
    CrossSection=item,
    New=True,
    Remove=True,
    LimitDistance_m=0.005,
    Bending=True,
    SetBucklingLength=True,
    ToPolylineMaxAngle=0.03,
    ToPolylineTolerance=0.01,
    ToPolylineMinEdgeLength=0.25)  # -> Element, Points, Info
beam_loads = BeamLoadsKaramba3D(
    BeamIdentifier=linetobeam.Element,
    LoadCase="LC4",
    ForceVector=Z_4,
    TStart="0.2",
    TEnd="0.5",
    mode="Block",
    menu=[buttons(off, off, on)])
beam_loads_2 = BeamLoadsKaramba3D(
    BeamIdentifier=linetobeam.Element,
    LoadCase="LC2",
    ForceVector=Z_5,
    TPosition="0.75",
    mode="Concentrated",
    menu=[buttons(on, off)])
beam_loads_3 = BeamLoadsKaramba3D(
    BeamIdentifier=linetobeam.Element,
    LoadCase="LC3",
    ForceVector=Z_6,
    TStart="0.2",
    TEnd="0.5",
    mode="Block",
    menu=[buttons(off, on, off)])
beam_loads_4 = BeamLoadsKaramba3D(
    BeamIdentifier=linetobeam.Element,
    LoadCase="LC5",
    ForceVector=Z_7,
    TStart="0.2",
    TStartPlateau="0.4",
    TEndPlateau="0.6",
    TEnd="0.8",
    mode="Trapezoidal",
    menu=[buttons(on, off, off)])
merge = Merge(Data1=loads, Data2=loads_2, Data3=beam_loads_2, Data4=beam_loads_3, Data5=beam_loads, Data6=beam_loads_4)  # -> flatten(Result)
panel_3 = Panel(linetobeam.Element)
assemble = AssembleModelKaramba3D(Elem=linetobeam.Element, Support=supp, Load=merge, Joint=beam_joints, LimitDistance_m=0.005)  # -> Model, Info, Mass_kg, CenterOfGravity, LoadCaseNames
analyze = AnalyzeKaramba3D(Model=assemble.Model)  # -> CalculatedModel, MaximumDisplacement_cm, ResultingForce_kN, ChangeOfElasticEnergy_kNm

# ---- group: Translational displacement of tip of cantilever in m
end_2 = EndPoints(Curve=ln)  # -> Start, End
panel_4 = Panel("""LC1
LC2
LC3
LC4
LC5
LC0""")
nodedisp = NodalDisplacementsKaramba3D(AnalysedModel=analyze.CalculatedModel, PositionsIndexes=end_2.End, LoadCaseCombination=panel_4)  # -> Model, NodalTranslations_m, NodalRotations_rad, LoadCaseIndex
panel_5 = Panel(nodedisp.NodalTranslations_m)

# ----
modelview = ModelViewKaramba3D(Model=analyze.CalculatedModel)  # -> Model, DeformedMesh, DeformedAxes, DeformedModel, MaximumDeformation
model = ModelKaramba(modelview.Model)
beamview = BeamViewKaramba3D(Model=model)  # -> Model, MeshesOfRenderedBeams, DeformedBeamAxes, LegendColors, LegendTags
legend = Legend(Colour=beamview.LegendColors, Tags=beamview.LegendTags, LegendType=1)
tobhom = ToBHoM(K3dModel=model, Component="{ .ToBHoM")
explode = Explode(Object=tobhom, Component="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")  # -> Nodes, Bars, Loads, LoadCases, CrossSections, Materials
rfem5settings = RFEM5Settings(Is2DModel=False, ZIsUp=True, Component="BH.oM.Adapters.RFEM5.RFEM5Settings")
merge_2 = Merge(Data1=explode.Nodes, Data2=explode.Bars, Data5=explode.CrossSections, Data6=explode.Materials)
explode_2 = Explode(Object=explode.Materials, Component="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")  # -> Name, Density, DampingRatio, PoissonsRatio, ThermalExpansionCoeff, YoungsModulus, YieldStress, UltimateStress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
panel_6 = Panel(explode.Materials)
rfem5adapter = RFEM5Adapter(FilePath="C:\temp\tests\RFEMtest", RfemSettings=rfem5settings, Active=Toggle(True), Component="{ ..ctor")
panel_7 = Panel([explode_2.Name, explode_2.Density, explode_2.DampingRatio, explode_2.PoissonsRatio, explode_2.ThermalExpansionCoeff, explode_2.YoungsModulus, explode_2.YieldStress, explode_2.UltimateStress])
push = Push(
    Adapter=rfem5adapter,
    Objects=flatten(merge_2),
    PushType="{ \"_t\" : \"System.Enum\", \"TypeName\" : { \"_t\" : \"System.Type\", \"Name\" : \"BH.oM.Adapter.PushType\", \"_bhomVersion\" : \"6.2\" }, \"Value\" : \"AdapterDefault\", \"_bhomVersion\" : \"6.2\" }",
    Active=Toggle(True),
    Component="{ .Push")  # -> Objects, Success
merge_3 = Merge(Data1=push.Objects, Data2=explode.Loads, Data3=explode.LoadCases)
push_2 = Push(
    Adapter=rfem5adapter,
    Objects=flatten(merge_3),
    PushType="{ \"_t\" : \"System.Enum\", \"TypeName\" : { \"_t\" : \"System.Type\", \"Name\" : \"BH.oM.Adapter.PushType\", \"_bhomVersion\" : \"6.2\" }, \"Value\" : \"AdapterDefault\", \"_bhomVersion\" : \"6.2\" }",
    Active=Toggle(True),
    Component="{ .Push")  # -> Objects, Success
