# Grasshopper definition Test-Convert-Material.gh (Grasshopper 1.0.7)
# plug-ins: Karamba3D, BH.UI.Grasshopper

getinfo = GetInfo(Component="{ .GetInfo")
# <Script name>
project_number = Panel("")
setprojectid = SetProjectID(ProjectID=project_number, Component="{ .SetProjectID")
bhom_version_used_to_create = Panel("5.2")
bhom_version_currently_installed = Panel(getinfo)
karamba3dadapter = Karamba3DAdapter(Component="{ ..ctor")
matselect = MaterialSelectionKaramba3D(menu=[dropdown(1), dropdown(2)])
push = Push(
    Adapter=karamba3dadapter,
    Objects=flatten(matselect),
    PushType="{ \"_t\" : \"System.Enum\", \"TypeName\" : { \"_t\" : \"System.Type\", \"Name\" : \"BH.oM.Adapter.PushType\", \"_bhomVersion\" : \"5.2\" }, \"Value\" : \"AdapterDefault\", \"_bhomVersion\" : \"5.2\" }",
    Active=False,
    Component="{ .Push")  # -> Objects, Success
tobhom = ToBHoM(Obj=matselect, Component="{ .ToBHoM")
explode = Explode(Object=tobhom, Component="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")  # -> Name, Density, DampingRatio, PoissonsRatio, ThermalExpansionCoeff, YoungsModulus, YieldStress, UltimateStress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
